# Grasshopper definition kuka_prc_test.ghx (Grasshopper 1.0.7)
# plug-ins: KUKA|prc - parametric robot control

# WARNING
# DONT FORGET TO CHANGE START POSITION
default_start_position = Panel("""0
-90
90
0
0
0
0
0
0
0""")

# ----
# General
# Setting
number_slider = Slider(0, range=0..1)
initial_vel_m_sec = Panel("0.005")
kr6_10_r1100_2 = AgilusKR610R11002Robot(infiniterot=False)
filename = Panel("DRYRUN")
save = BooleanToggle(False)
list = ValueList({"IP to GP": 0, "GP to TP01": 1, "TP01 to TP02": 2, "TP02 to TP03": 3}, selected="TP02 to TP03")
python = GhPythonScript(prefix=filename, iter=list, update=save)  # -> out, filename
# ---------- python: Python ----------
__author__ = "trtku"
__version__ = "2022.09.26"

from datetime import datetime as dt

today = str(dt.today()).translate(None, '-')
today = today.split(' ')[0]

filename = prefix + "_" + str(iter) + "_" + today
# ---------- end python ----------

# ----
# Scene
# Planning
mesh = Mesh([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])
mesh_2 = Mesh(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)
mesh_3 = Mesh(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)

# ----
# Tool
# Settings
tool_height = Panel("555")
tool_mound_radius = Panel("40")
mesh_4 = Mesh(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)
custom_tool = CustomToolKUKAPrc(
    CustomToolGeometry=mesh_4,
    toolid=4,
    toolvala=0,
    toolvalb=0,
    toolvalc=0,
    toolvalx=0,
    toolvaly=0,
    toolvalz=0,
    valuesset=True)

# ----
# Ground
# Plane
number_slider_2 = Slider(360, range=-1000..1000)
y_angle = Slider(-90, range=-180..180)
z_angle = Slider(45, range=-180..180)
x_angle = Slider(0, range=-180..180)
vel_to_ths_plane_m_sec = Panel("0.01")
addition = Addition(A=Slider(-284, range=-1000..1000), B=tool_height)
pt = ConstructPoint(XCoordinate=number_slider_2, YCoordinate=Slider(-375, range=-1000..1000), ZCoordinate=addition)
rad = Radians(Degrees=x_angle)
rad_2 = Radians(Degrees=y_angle)
rad_3 = Radians(Degrees=z_angle)
X = UnitX(Factor=1)
Y = UnitY(Factor=1)
pl = ConstructPlane(Origin=pt, XAxis=expr("-x", X), YAxis=Y)
deplane = DeconstructPlane(Plane=pl)  # -> Origin, XAxis, YAxis, ZAxis
rot3d = Rotate3D(Geometry=pl, Angle=rad, Center=deplane.Origin, Axis=deplane.XAxis)  # -> Geometry, Transform
deplane_2 = DeconstructPlane(Plane=rot3d.Geometry)  # -> Origin, XAxis, YAxis, ZAxis
rot3d_2 = Rotate3D(Geometry=rot3d.Geometry, Angle=rad_2, Center=deplane_2.Origin, Axis=deplane.YAxis)  # -> Geometry, Transform
deplane_3 = DeconstructPlane(Plane=rot3d_2.Geometry)  # -> Origin, XAxis, YAxis, ZAxis
rot3d_3 = Rotate3D(Geometry=rot3d_2.Geometry, Angle=rad_3, Center=deplane_3.Origin, Axis=deplane_3.XAxis)  # -> Geometry, Transform
pln = Plane(rot3d_3.Geometry)
num = Number(vel_to_ths_plane_m_sec)

# ----
# Approach
# Plane
pln_2 = Plane(pln)
safe_distance = Slider(517, range=0..1000)
vel_to_ths_plane_m_sec_2 = Panel("0.01")
Z = UnitZ(Factor=safe_distance)
move = Move(Geometry=pln_2, Motion=Z)  # -> Geometry, Transform
pln_3 = Plane(move.Geometry)
num_2 = Number(vel_to_ths_plane_m_sec_2)

# ----
# Target
# Plane01
vel_to_ths_plane_m_sec_3 = Panel("0.001")
pln_4 = Plane(pln)
safe_distance_2 = Slider(100, range=0..1000)
Z_2 = UnitZ(Factor=safe_distance_2)
move_2 = Move(Geometry=pln_4, Motion=Z_2)  # -> Geometry, Transform
pln_5 = Plane(move_2.Geometry)
num_3 = Number(vel_to_ths_plane_m_sec_3)

# ----
# Target
# Plane02
vel_to_ths_plane_m_sec_4 = Panel("0.001")
pln_6 = Plane(pln_5)
safe_distance_3 = Slider(100, range=0..1000)
Z_3 = UnitZ(Factor=safe_distance_3)
move_3 = Move(Geometry=pln_6, Motion=Z_3)  # -> Geometry, Transform
pln_7 = Plane(move_3.Geometry)
num_4 = Number(vel_to_ths_plane_m_sec_4)

# ----
# Target
# Plane03
vel_to_ths_plane_m_sec_5 = Panel("0.001")
pln_8 = Plane(pln_7)
safe_distance_4 = Slider(100, range=0..1000)
Z_4 = UnitZ(Factor=safe_distance_4)
move_4 = Move(Geometry=pln_8, Motion=Z_4)  # -> Geometry, Transform
pln_9 = Plane(move_4.Geometry)
num_5 = Number(vel_to_ths_plane_m_sec_5)

merge = Merge(Data1=mesh, Data2=mesh_2, Data3=mesh_3)
merge_2 = Merge(Data1=pln_9, Data2=num_5)  # -> graft(Result)
merge_3 = Merge(Data1=pln_3, Data2=num_2)  # -> graft(Result)
merge_4 = Merge(Data1=pln, Data2=num)  # -> graft(Result)
merge_5 = Merge(Data1=pln_5, Data2=num_3)  # -> graft(Result)
merge_6 = Merge(Data1=pln_7, Data2=num_4)  # -> graft(Result)

# ----
# TP02 to TP03
merge_7 = Merge(Data1=merge_6, Data2=merge_2)  # -> simplify(Result)

# ----
# IP to GP
merge_8 = Merge(Data1=merge_3, Data2=merge_4)  # -> simplify(Result)

# ----
# GP to TP01
merge_9 = Merge(Data1=merge_4, Data2=merge_5)  # -> simplify(Result)

# ----
# TP01 to TP02
merge_10 = Merge(Data1=merge_5, Data2=merge_6)  # -> simplify(Result)

filter = StreamFilter(Gate=list, Stream0=merge_8, Stream1=merge_9, Stream2=merge_10, Stream3=merge_7)
panel = Panel(filter)
path = DataPath("{0}")
path_2 = DataPath("{1}")
branch = TreeBranch(Tree=filter, Path=path, MaintainPaths=True)
branch_2 = TreeBranch(Tree=filter, Path=path_2, MaintainPaths=True)
lin_move = LINearMovementKUKAPrc(TargetAsPlane=branch, Speed=branch_2, extaxenabled=False)
kuka_prc = KUKAPrcCORE(
    SimulationSlider=number_slider,
    KUKAPrcCommands=lin_move,
    Tool=custom_tool,
    Robot=kr6_10_r1100_2,
    CollisionGeometry=merge,
    SaveToggle=save,
    Filename=python.filename,
    PRC_BaseExpose=False,
    PRC_SaveNameExpose=True,
    PRCsettings="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")  # -> RobotGeometry, AnalysisOutput
